# Grasshopper definition Zoom Bounding Box.gh (Grasshopper 0.9.14)

sph = Sphere(Base=PlaneXY(0, 0, 0), Radius=1)
zbb = CSharpScript(box=sph, run=Button())  # -> out, A, B; inputs box: Box, run: Boolean
# ---------- zbb: C# ----------
    if(run && box.IsValid){
   //   Guid ID = doc.Objects.AddBrep(box.ToBrep());
      doc.Views.ActiveView.ActiveViewport.ZoomBoundingBox(box.BoundingBox);
    //  Rhino.RhinoApp.RunScript("_SelLast _SelLast _ZoomSelected", false);
      //doc.Objects.Delete(ID, true);
    //  B = ID;
    }
# ---------- end zbb ----------
