# Grasshopper definition text table.gh (Grasshopper 0.9.14)
# plug-ins: ComponentHacks, HDTReference, LunchBox

panel = Panel("""1
2
3""")
excelread = ExcelReader(ReadToggle=Toggle(True), Worksheet=1, Column=panel, RowStart=1, RowEnd="10")  # -> Exceptions, ExcelData
slider = Slider(1, range=0..10)
slider_2 = Slider(1, range=0..10)
slider_3 = Slider(1, range=0..10)
start_point = Point([Point(171.8713915, 132.1566438, 0), Point(162.2694567, 132.1566438, 0), Point(148.984588, 121.1078422, 0)])
text_font = String("Arial")
start_point_2 = Point(start_point)
text_font_2 = String(Slider(57, range=0..100))
text = String(excelread.ExcelData)
text_size = Number([slider_2, slider_3, slider])
text_color = Colour(ColourSwatch(SwatchColor=RGB(56, 180, 194)))
offset_amount = Number(Slider(1, range=0..100))
item = ListItem(List=start_point_2, Index=0, Wrap=False)
simplify = SimplifyTree(Tree=text, Front=False)
origin = Origin(item)
text_font_3 = String(text_font_2)
justified_text = JustifiedText3d(Size=1, HorizontalAlignment=1, VerticalAlginment=1)
pline = PolyLine(Vertices=start_point_2, Closed=False)
c_script = CSharpScript(L=origin, T=simplify, S=graft(text_size), F=text_font_3)  # -> out, A; inputs L: Plane, T: String, S: Double, F: Int32
# ---------- c_script: C# ----------
    Rhino.Geometry.TextEntity entity = new Rhino.Geometry.TextEntity();
    entity.TextHeight = S;
    entity.Text = T;
    entity.Plane = L;
    entity.FontIndex = F;
    A = entity.Explode();

    //  A = entity.GetBoundingBox(true);
# ---------- end c_script ----------
bbox = BoundingBox(Content=c_script.A, Plane=PlaneXY(0, 0, 0), UnionBox=True)  # -> Box, Box_2
group = Group(Objects=c_script.A)
path_mapper = PathMapper(bbox.Box, source="{A;B;C}", target="{A;B}")
box = BoxComponents(Box=path_mapper)  # -> Plane, X, Y, Z
domcomp = DomainComponents(Domain=box.Y)  # -> Start, End
domcomp_2 = DomainComponents(Domain=box.X)  # -> Start, End
subtraction = Subtraction(A=domcomp_2.End, B=domcomp_2.Start)
subtraction_2 = Subtraction(A=domcomp.End, B=domcomp.Start)
addition = Addition(A=offset_amount, B=subtraction)
addition_2 = Addition(A=offset_amount, B=subtraction_2)
flip = FlipMatrix(Data=addition)
sort = SortList(Keys=addition_2)  # -> Keys, ValuesA
sort_2 = SortList(Keys=flip)  # -> Keys, ValuesA
rev = ReverseList(List=sort.Keys)
rev_2 = ReverseList(List=sort_2.Keys)
item_2 = ListItem(List=rev, Index=0, Wrap=False)
item_3 = ListItem(List=rev_2, Index=0, Wrap=False)
ma = MassAddition(Input=flatten(["0", item_2]))  # -> Result, PartialResults
ma_2 = MassAddition(Input=flatten(["0", item_3]))  # -> Result, PartialResults
lng = ListLength(List=ma.PartialResults)
lng_2 = ListLength(List=ma_2.PartialResults)
division = Division(A=offset_amount, B=2)
cull_i = CullIndex(List=ma_2.PartialResults, Indices=expr("i-1", lng_2), Wrap=False)
cull_i_2 = CullIndex(List=ma.PartialResults, Indices=expr("i-1", lng), Wrap=False)
vec = VectorXYZ(XComponent=division, YComponent=graft(division), ZComponent="0")  # -> Vector, Length
vec_2 = VectorXYZ(XComponent=cull_i, YComponent=graft(cull_i_2), ZComponent="0")  # -> Vector, Length
addition_3 = Addition(A=vec_2.Vector, B=vec.Vector)
xy = XYPlane(Origin=origin)
vec_3 = VectorXYZ(XComponent=flatten(item_3), YComponent=item_2, ZComponent="0")  # -> Vector, Length
move = Move(Geometry=group, Motion=graft(addition_3))  # -> Geometry, Transform
move_2 = Move(Geometry=xy, Motion=graft(vec_2.Vector))  # -> Geometry, Transform
move_3 = Move(Geometry=move_2.Geometry, Motion=graft(vec_3.Vector))  # -> Geometry, Transform
ungroup = Ungroup(Group=move.Geometry)
rec_2pt = Rectangle2Pt(Plane=PlaneXY(0, 0, 0), PointA=move_3.Geometry, PointB=move_2.Geometry, Radius=0)  # -> Rectangle, Length
planar = PlanarSrf(Edges=ungroup)
geo = Geometry(rec_2pt.Rectangle)
bbox_2 = BoundingBox(Content=flatten(geo), Plane=PlaneXY(0, 0, 0), UnionBox=True)  # -> Box, Box_2
offset_num = Number(offset_amount)
Z = UnitZ(Factor="-.01")
vec_4 = VectorXYZ(XComponent=expr("x/4", offset_num), YComponent=expr("-y/4", offset_num), ZComponent="-.5")  # -> Vector, Length
move_4 = Move(Geometry=bbox_2.Box, Motion=Z)  # -> Geometry, Transform
move_5 = Move(Geometry=move_4.Geometry, Motion=vec_4.Vector)  # -> Geometry, Transform
text_color_2 = Colour(text_color)
previewlw = CustomPreviewLineWeights(Geometry=[rec_2pt.Rectangle, pline], Shader=ColourSwatch(SwatchColor=RGB(0, 0, 0)), Thickness=Slider(2, range=0..10))
preview = CustomPreview(Geometry=move_5.Geometry, Shader=ColourSwatch(SwatchColor=RGB(110, 110, 110)))
preview_2 = CustomPreview(Geometry=move_4.Geometry, Shader=ColourSwatch(SwatchColor=RGB(255, 255, 255)))
preview_3 = CustomPreview(Geometry=planar, Shader=text_color_2)
