# Grasshopper definition textBoundingBox.gh (Grasshopper 0.9.14)

slider = Slider(5, range=0..10)
pan = Panel("This is a piece of text")
origin = Origin(Point(0, 0, 0))
c_script = CSharpScript(L=origin, T=pan, S=slider)  # -> out, A; inputs L: Plane, T: String, S: Double
# ---------- c_script: C# ----------
    Rhino.Geometry.TextEntity entity = new Rhino.Geometry.TextEntity();
    entity.TextHeight = S;
    entity.Text = T;
    entity.Plane = L;
    A = entity.Explode();

    //  A = entity.GetBoundingBox(true);
# ---------- end c_script ----------
tag = TextTag3D(Location=origin, Text=pan, Size=slider)
bbox = BoundingBox(Content=c_script.A, Plane=PlaneXY(0, 0, 0), UnionBox=True)  # -> Box, Box_2
